# Grasshopper definition Demo.gh (Grasshopper 1.0.7)
# plug-ins: Tree3DGH

button = Button()
blendtype = BlendType(ConfirmButton=button)
blendtype_2 = BlendType(ConfirmButton=button)
brep = Brep(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)
brep_2 = Brep(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)
panel = Panel(blendtype)
panel_2 = Panel(blendtype_2)
createblend = CreateBlend(Geometries=brep_2, BlendType=blendtype_2)
createblend_2 = CreateBlend(Geometries=brep, BlendType=blendtype)
crv = Curve(<curve referenced from the Rhino model>)
createtree = CreateTree(
    CentralLeaderCurve=crv,
    Spacing=Slider(56.04, range=0..1000),
    Gypsophila=createblend,
    Fern=createblend_2,
    Seed=Slider(831, range=0..1000),
    GrowOnEnds=Toggle(True))
pipe = Pipe(Curve=crv, Radius=Slider(3.63, range=0..10), Caps=0)
visualizetree = VisualizeTree(Tree=createtree)  # -> Branches, Geometries
item = ListItem(List=visualizetree.Branches, Index=Slider(2, range=0..10), Wrap=True)
number_slider = Slider(57.82, range=0..100)
modifybranch = ModifyBranch(
    Branch=item,
    NumberOfBlends=Slider(1, range=0..10),
    NumberOfNeighbors=Slider(1, range=0..5),
    Rotation=number_slider,
    Tree=createtree)  # -> Blends, Blends_2
modifyblend = ModifyBlend(Blend=modifybranch.Blends_2, Rotation=number_slider, Tree=createtree)
visualizetree_2 = VisualizeTree(Tree=modifybranch.Blends)  # -> Branches, Geometries
